vi "Main.gvi"   [LabVIEW NXG 5.0.0]
# This template is for the Queued Message Handler design pattern.
# The Event Handling Loop generates messages based on user interface actions.
# The Message Handling Loop processes messages generated by the Event Handling Loop, or by other messages.  The messages are string values, so new messages can be added easily to the Message Cases case structure in the Message Handling Loop.  Each message cluster can also provide an optional value for Message Data, which is a variant that can be converted to whatever message-specific data is required.
panel controls:
  "Exit": bool
  "TEMP Button": bool
  "LUX Button": bool
  "VISA Resource Name": "VISA Instr" = "COM5"
  "Initialize VISA": bool
  "CMD Button": bool
  "Initialize AI": bool
  "PV Config Button": bool
  "Set PV Angle Button": bool
  "IR Thermometer Config Button": bool
  "Fans Button": bool
  "Brightness Config Button": bool
  "Optic Filter Config Button": bool
  "Reset CVM Button": bool
  "Stop": bool
  "PV Config Selector": string
  "PV Angle": i32
  "Fans Selector": string
  "Optic Filter Selector": string
  "IR Thermometer Selector": string
  "Brightness": i32
  "Prepare CVM Button": bool
  "write buffer": string = "@DO 34 0#"
  "Set Resistance Button": bool
  "Reset Resistance Button": bool
  "Resistance String": string
  "VAC Button": bool
panel indicators:
  "Display": string
  "CMD": "TAG.gtype"
  "LUX_2": "TAG.gtype"
  "TEMP_2": "TAG.gtype"
  "Chart": waveform<f64>[]
  "Maсhine State": string
  "Image": "Vision IMAQImage"
  "Voltage Range": f64
  "Voltage coeff": f64
  "Current coeff": f64
  "V_real": f64
  "Current_real": f64
  "VAC Load Counter": i32
  "Graph": f64[]
  "Output": error
  "VISA Answer_2": "TAG.gtype"[]
  "VISA Answer": "TAG.gtype"[]
  "Graph_2": f64[]
types:
  "TAG.gtype" = cluster{"Timestamp": timestamp, "DATA": string}
  "DataType.gtype" = enum{"Double", "I32", "String", "Boolean", "U64", "Timestamp"}
  "Tag.gtype" = cluster{"Path": string, "Datatype": "DataType.gtype", "Configuration": "Configuration.gtype"}
  "Client Handle.gtype" = u32
  "Configuration.gtype" = cluster{"Server URL": string, "Session": "Client Handle.gtype", "Raw Session Queue": Queue<"Client Handle.gtype">}
  T1 = cluster{"VISA Resource": "VISA Instr", "Physical Channel": "DAQmx Task", "tag": "Tag.gtype", "configuration": "Configuration.gtype"}
  "UI Data.gtype" = cluster{"Boolean <Replace Me>": bool, "String <Replace Me>": string, "Numeric <Replace Me>": f64}
  "ValueRange.gtype" = cluster{"maximum value": f64, "minimum value": f64}
uses:
  Message Queue::Create All Message Queues.gvi
  Message Queue::Enqueue Message (Single).gvi
  Support::Error Handler - Event Handling Loop.gvi
  Message Queue::Dequeue Message.gvi
  NI::VISA::Configure Serial Port (Instr).gvi
  NI::VISA::Open (Instr).gvi
  NI::Skyline::Configuration::Open Configuration API Key.gvi
  NI::Skyline::TagHTTP::Open Tag.gvi
  NI::DAQmx::Internal::DAQmx Create Channel (AI-Voltage-Basic).gvi
  Queued Message Handler::Read_Write_VISA.gvi
  Queued Message Handler::PV_switch.gvi
  Queued Message Handler::CMD_Iteration.gvi
  NI::DAQmx::Internal::DAQmx Read (Analog 2D DBL NChan NSamp).gvi
  NI::DAQmx::Internal::DAQmx Read (Analog 1D Wfm NChan NSamp).gvi
  NI::G Core::Error::Display Error.gvi
  NI::Skyline::Configuration::Close Configuration.gvi
  NI::Skyline::TagHTTP::Close Tag (Single).gvi
  NI::DAQmx::Internal::DAQmx Stop Task.gvi
  NI::VISA::Close (Instr).gvi
  NI::G Core::Error::Build Error Cluster.gvi
  Support::Error Handler - Message Handling Loop.gvi
  NI::Vision::IMAQdx::Initialize.gvi
  NI::Vision::IMAQdx::Configure Grab.gvi
  NI::Vision::Core::Basics::Create Image.gvi
  NI::Vision::IMAQdx::Grab.gvi
  NI::Vision::IMAQdx::Close.gvi
diagram:
  disable {
    frame Enabled { }
    frame Disabled {
      Destroy User Event()
    }
  }
  w1 = bool FALSE  # Stop Event
  Create User Event[EventName="Stop Event"](user event data type=w1) -> (error out=w2, user event out=w3)
  Register For Events("Stop Event"=w3) -> (event registration refnum out=w4)
  call "Create All Message Queues.gvi"(error in=w2) -> (message queues=w5, error out=w6)
  Property Node(instance in=w5) -> ("UI"=w7)
  s1 = w4  # shift register
  while {
    event (dynamic events = s1) {
      on "TEMP Button" Value changed {
        call "Enqueue Message (Single).gvi"(message queue in=w7, message="Get Temperature") -> (message queue out=w10, error out=w9)
        w8 = default
      }
      on "LUX Button" Value changed {
        call "Enqueue Message (Single).gvi"(message queue in=w7, message="Get Brightness") -> (message queue out=w10, error out=w9)
        w8 = default
      }
      on "Exit" Value changed {
        call "Enqueue Message (Single).gvi"(priority message=TRUE, message queue in=w7, message="Exit") -> (message queue out=w10, error out=w9)
        w8 = default
      }
      on dynamic event 0 {
        $Display <- "\"Exit\" button pressed"
        w8 = TRUE
        w9 = default
        w10 = w7
      }
      on "Window" Close? {
        call "Enqueue Message (Single).gvi"(priority message=TRUE, message queue in=w7, message="Exit") -> (message queue out=w10)
        Event Filter("Discard?"=TRUE)
        w8 = default
        w9 = default
      }
      on "Initialize VISA" Value changed {
        call "Enqueue Message (Single).gvi"(message queue in=w7, message="Initialize VISA") -> (message queue out=w10, error out=w9)
        w8 = default
      }
      on "CMD Button" Value changed {
        call "Enqueue Message (Single).gvi"(message queue in=w7, message="Send CMD") -> (message queue out=w10, error out=w9)
        w8 = default
      }
      on "Reset CVM Button" Value changed {
        call "Enqueue Message (Single).gvi"(message queue in=w7, message="Reset CVM") -> (message queue out=w10, error out=w9)
        w8 = default
      }
      on "Initialize AI" Value changed {
        call "Enqueue Message (Single).gvi"(message queue in=w7, message="Initialize AI") -> (message queue out=w10, error out=w9)
        w8 = default
      }
      on "PV Config Button" Value changed {
        call "Enqueue Message (Single).gvi"(message queue in=w7, message="PV Config", message data=$"PV Config Selector") -> (message queue out=w10, error out=w9)
        w8 = default
      }
      on "Set PV Angle Button" Value changed {
        call "Enqueue Message (Single).gvi"(message queue in=w7, message="Set PV Angle", message data=$"PV Angle") -> (message queue out=w10, error out=w9)
        w8 = default
      }
      on "IR Thermometer Config Button" Value changed {
        call "Enqueue Message (Single).gvi"(message queue in=w7, message="IR Thermometer", message data=$"IR Thermometer Selector") -> (message queue out=w10, error out=w9)
        w8 = default
      }
      on "Fans Button" Value changed {
        call "Enqueue Message (Single).gvi"(message queue in=w7, message="Fans Control", message data=$"Fans Selector") -> (message queue out=w10, error out=w9)
        w8 = default
      }
      on "Brightness Config Button" Value changed {
        call "Enqueue Message (Single).gvi"(message queue in=w7, message="Brightness Config", message data=$Brightness) -> (message queue out=w10, error out=w9)
        w8 = default
      }
      on "Optic Filter Config Button" Value changed {
        call "Enqueue Message (Single).gvi"(message queue in=w7, message="Optic Filter Config", message data=$"Optic Filter Selector") -> (message queue out=w10, error out=w9)
        w8 = default
      }
      on "Prepare CVM Button" Value changed {
        call "Enqueue Message (Single).gvi"(message queue in=w7, message="Prepare CVM") -> (message queue out=w10, error out=w9)
        w8 = default
      }
      on "Set Resistance Button" Value changed {
        call "Enqueue Message (Single).gvi"(message queue in=w7, message="Set Resistance", message data=$"Resistance String") -> (message queue out=w10, error out=w9)
        w8 = default
      }
      on "Reset Resistance Button" Value changed {
        call "Enqueue Message (Single).gvi"(message queue in=w7, message="Reset Resistance") -> (message queue out=w10, error out=w9)
        w8 = default
      }
      on "VAC Button" Value changed {
        Get Current Time() -> (current time=w11)
        call "Enqueue Message (Single).gvi"(message queue in=w7, message="VAC", message data=w11) -> (message queue out=w10)
        $"VAC Load Counter" <- 0
        w8 = default
        w9 = default
      }
    }
    call "Error Handler - Event Handling Loop.gvi"(message queue in=w10, error in=w9) -> (dup error in=w12)
    stop if w8
  }
  Unregister For Events(error in=w12, event registration refnum=s1)
  w13 = T1 {"VISA Resource"="COM5", "Physical Channel"="", "tag"={"Path"="", "Datatype"="Double", "Configuration"={"Server URL"="", "Session"=0, "Raw Session Queue"=refnum}}, "configuration"={"Server URL"="", "Session"=0, "Raw Session Queue"=refnum}}
  s2 = "UI Data.gtype" {all zero or empty}  # shift register
  s3 = w13  # shift register
  while {
    call "Dequeue Message.gvi"(message queue in=w7, error in=w6) -> (message queue out=w14, message=w15, message data=w16, error out=w17)
    $"Maсhine State" <- w15
    # s2: Data
    # w3: Stop Event
    case (w15) ignore case {  # Message Cases
      frame "Initialize" {
        call "Enqueue Message (Single).gvi"(message queue in=w14, message="Initialize VISA", error in=w17) -> (message queue out=w22, error out=w23)
        call "Enqueue Message (Single).gvi"(message queue in=w22, message="Initialize AI", error in=w23) -> (message queue out=w24, error out=w25)
        call "Enqueue Message (Single).gvi"(message queue in=w24, message="Initialize SLC", error in=w25) -> (message queue out=w26, error out=w27)
        call "Enqueue Message (Single).gvi"(message queue in=w26, message="Reset CVM", error in=w27) -> (message queue out=w28, error out=w29)
        call "Enqueue Message (Single).gvi"(message queue in=w28, message="Fans Control", message data="Turn All Off", error in=w29) -> (message queue out=w30, error out=w31)
        call "Enqueue Message (Single).gvi"(message queue in=w30, message="Wait For Event", error in=w31) -> (error out=w18)
        w19 = s2
        w20 = default
        w21 = s3
      }
      frame "Wait For Event" {
        call "Enqueue Message (Single).gvi"(message queue in=w14, message="Watchdog", error in=w17) -> (error out=w18)
        w19 = s2
        w20 = default
        w21 = s3
      }
      frame "Initialize VISA" {
        call "Configure Serial Port (Instr).gvi"(stop bits="1.0"(10), session in=$"VISA Resource Name", baud rate=115200, parity="None"(0), termination char=0xA, enable termination char=TRUE) -> (session out=w32, error out=w33)
        call "Open (Instr).gvi"(resource name=w32, error in=w33) -> (session out=w34, error out=w35)
        Property Node(instance in=s3, "VISA Resource"=w34) -> (instance out=w21)
        Wait(time to wait=2000)
        Merge Errors(w35, w17) -> (error out=w18)
        w19 = s2
        w20 = default
      }
      frame "Initialize SLC" {
        call "Open Configuration API Key.gvi"(server url="https://api.systemlinkcloud.com/", api key="zYUbuW0YNkg1G__lXfJiGVBNWME-HlVd2a5NUHp-IP") -> (configuration=w36, error out=w37)
        call "Open Tag.gvi"(path="PV_T", data type="String", error in=w37, configuration=w36) -> (tag=w38, error out=w39)
        Property Node(instance in=s3, "tag"=w38, "configuration"=w36) -> (instance out=w21)
        Wait(time to wait=2000)
        Merge Errors(w39, w17) -> (error out=w18)
        w19 = s2
        w20 = default
      }
      frame "Initialize AI" {
        call "DAQmx Create Channel (AI-Voltage-Basic).gvi"(physical channels="Dev1/ai0:1,Dev1/ai3,Dev1/ai7", units="Volts"(10348), measurement range="ValueRange.gtype" {"maximum value"=10, "minimum value"=0}, input terminal configuration="RSE"(10083)) -> (task out=w40, error out=w41)
        Property Node(instance in=s3, "Physical Channel"=w40) -> (instance out=w21)
        Merge Errors(w41, w17) -> (error out=w18)
        w19 = s2
        w20 = default
      }
      frame "Send CMD" {
        Property Node(instance in=s3) -> ("VISA Resource"=w42, instance out=w21)
        call "Read_Write_VISA.gvi"(VISA_IN=w42, CMD=$"write buffer", ERROR_IN=w17) -> (TAG=w43, ERROR_OUT=w44)
        $CMD <- w43
        call "Enqueue Message (Single).gvi"(message queue in=w14, message="Wait For Event", error in=w44) -> (error out=w18)
        w19 = s2
        w20 = default
      }
      frame "PV Config" {
        Property Node(instance in=s3) -> ("VISA Resource"=w45, instance out=w21)
        Variant To Data(error in (no error)=w17, type=string "", variant=w16) -> (data=w46, error out=w47)
        call "PV_switch.gvi"(VISA_IN=w45, CTRL="Disconnect", ERROR_IN=w47) -> (VISA_OUT=w48, ERROR_OUT=w49)
        case (w46) {
          frame "Single", Default {
            w52 = ["@DO 17 0#", "@DO 18 1#", "@DO 23 1#", "@DO 24 1#", "@DO 25 1#", "@DO 26 0#", "@DO 27 0#", "@DO 28 0#", "@DO 29 1#", "@DO 30 1#", "@DO 31 1#", "@DO 32 1#", "@DO 33 0#"]
            w53 = ["@DO 54 1#", "@DO 55 1#", "@DO 56 1#", "@DO 57 1#", "@DO 58 1#", "@DO 59 1#", "@DO 60 1#", "@DO 61 1#"]
            # @DO 17 0#
            # @DO 18 1#
            # @DO 23 1#
            # @DO 24 1#
            # @DO 25 1#
            # @DO 26 0#
            # @DO 27 0#
            # @DO 28 0#
            # @DO 29 1#
            # @DO 30 1#
            # @DO 31 1#
            # @DO 32 1#
            # @DO 33 0#
            #
            # 03,08,2020
            # 19:51
            Insert Into Array(inArray=w52, new=w53) -> w54
            call "CMD_Iteration.gvi"(VISA_IN=w48, ARRAY_IN=w54, ERROR_IN=w49) -> (VISA Answer=w51, ERROR_OUT=w50)
          }
          frame "Parallel 2" {
            # @DO 17 1#
            # @DO 18 0#
            # @DO 23 1#
            # @DO 24 0#
            # @DO 25 1#
            # @DO 26 1#
            # @DO 27 1#
            # @DO 28 1#
            # @DO 29 1#
            # @DO 30 1#
            # @DO 31 1#
            # @DO 32 1#
            # @DO 33 1#
            #
            # 03.08.2020
            # 19.53
            w55 = ["@DO 17 1#", "@DO 18 0#", "@DO 23 1#", "@DO 24 0#", "@DO 25 1#", "@DO 26 1#", "@DO 27 1#", "@DO 28 1#", "@DO 29 1#", "@DO 30 1#", "@DO 31 1#", "@DO 32 1#", "@DO 33 1#"]
            # Disconnect all Diodes
            w56 = ["@DO 54 1#", "@DO 55 1#", "@DO 56 1#", "@DO 57 1#", "@DO 58 1#", "@DO 59 1#", "@DO 60 1#", "@DO 61 1#"]
            Insert Into Array(inArray=w55, new=w56) -> w57
            call "CMD_Iteration.gvi"(VISA_IN=w48, ARRAY_IN=w57, ERROR_IN=w49) -> (VISA Answer=w51, ERROR_OUT=w50)
          }
          frame "Parallel 2 Diode" {
            # @DO 17 1#
            # @DO 18 0#
            # @DO 23 1#
            # @DO 24 0#
            # @DO 25 1#
            # @DO 26 1#
            # @DO 27 1#
            # @DO 28 1#
            # @DO 29 1#
            # @DO 30 1#
            # @DO 31 1#
            # @DO 32 1#
            # @DO 33 1#
            #
            # 03.08.2020
            # 19.54
            w58 = ["@DO 17 1#", "@DO 18 0#", "@DO 23 1#", "@DO 24 0#", "@DO 25 1#", "@DO 26 1#", "@DO 27 1#", "@DO 28 1#", "@DO 29 1#", "@DO 30 1#", "@DO 31 1#", "@DO 32 1#", "@DO 33 1#"]
            # @DO 56 0#
            # @DO 57 0#
            #
            # 19.54
            w59 = ["@DO 54 1#", "@DO 55 1#", "@DO 56 0#", "@DO 57 0#", "@DO 58 1#", "@DO 59 1#", "@DO 60 1#", "@DO 61 1#"]
            Insert Into Array(inArray=w58, new=w59) -> w60
            call "CMD_Iteration.gvi"(VISA_IN=w48, ARRAY_IN=w60, ERROR_IN=w49) -> (VISA Answer=w51, ERROR_OUT=w50)
          }
          frame "Series 2" {
            # @DO 17 0#
            # @DO 18 1#
            # @DO 23 1#
            # @DO 24 0#
            # @DO 25 1#
            # @DO 26 1#
            # @DO 27 1#
            # @DO 28 1#
            # @DO 29 0#
            # @DO 30 1#
            # @DO 31 1#
            # @DO 32 0#
            # @DO 33 0#
            #
            # 03.08.2020
            # 19.55
            w61 = ["@DO 17 0#", "@DO 18 1#", "@DO 23 1#", "@DO 24 0#", "@DO 25 1#", "@DO 26 1#", "@DO 27 1#", "@DO 28 1#", "@DO 29 0#", "@DO 30 1#", "@DO 31 1#", "@DO 32 0#", "@DO 33 0#"]
            w62 = ["@DO 54 1#", "@DO 55 1#", "@DO 56 1#", "@DO 57 1#", "@DO 58 1#", "@DO 59 1#", "@DO 60 1#", "@DO 61 1#"]
            Insert Into Array(inArray=w61, new=w62) -> w63
            call "CMD_Iteration.gvi"(VISA_IN=w48, ARRAY_IN=w63, ERROR_IN=w49) -> (VISA Answer=w51, ERROR_OUT=w50)
          }
          frame "Series 2 Diode" {
            # @DO 17 0#
            # @DO 18 1#
            # @DO 23 1#
            # @DO 24 0#
            # @DO 25 1#
            # @DO 26 1#
            # @DO 27 1#
            # @DO 28 1#
            # @DO 29 0#
            # @DO 30 1#
            # @DO 31 1#
            # @DO 32 0#
            # @DO 33 0#
            #
            # 03.08.2020
            # 19.57
            w64 = ["@DO 17 0#", "@DO 18 1#", "@DO 23 1#", "@DO 24 0#", "@DO 25 1#", "@DO 26 1#", "@DO 27 1#", "@DO 28 1#", "@DO 29 0#", "@DO 30 1#", "@DO 31 1#", "@DO 32 0#", "@DO 33 0#"]
            # @DO 60 0#
            # @DO 61 0#
            #
            # 03.08.2020
            w65 = ["@DO 54 1#", "@DO 55 1#", "@DO 56 1#", "@DO 57 1#", "@DO 58 1#", "@DO 59 1#", "@DO 60 0#", "@DO 61 0#"]
            Insert Into Array(inArray=w64, new=w65) -> w66
            call "CMD_Iteration.gvi"(VISA_IN=w48, ARRAY_IN=w66, ERROR_IN=w49) -> (VISA Answer=w51, ERROR_OUT=w50)
          }
          frame "Parallel 4" {
            # @DO 17 1#
            # @DO 18 1#
            # @DO 23 1#
            # @DO 24 1#
            # @DO 25 1#
            # @DO 26 1#
            # @DO 27 1#
            # @DO 28 1#
            # @DO 29 1#
            # @DO 30 1#
            # @DO 31 1#
            # @DO 32 1#
            # @DO 33 1#
            #
            # 03.08.2020
            # 19.59
            w67 = ["@DO 17 1#", "@DO 18 1#", "@DO 23 1#", "@DO 24 1#", "@DO 25 1#", "@DO 26 1#", "@DO 27 1#", "@DO 28 1#", "@DO 29 1#", "@DO 30 1#", "@DO 31 1#", "@DO 32 1#", "@DO 33 1#"]
            w68 = ["@DO 54 1#", "@DO 55 1#", "@DO 56 1#", "@DO 57 1#", "@DO 58 1#", "@DO 59 1#", "@DO 60 1#", "@DO 61 1#"]
            Insert Into Array(inArray=w67, new=w68) -> w69
            call "CMD_Iteration.gvi"(VISA_IN=w48, ARRAY_IN=w69, ERROR_IN=w49) -> (VISA Answer=w51, ERROR_OUT=w50)
          }
          frame "Parallel 4 Diode" {
            # @DO 17 1#
            # @DO 18 1#
            # @DO 23 1#
            # @DO 24 1#
            # @DO 25 1#
            # @DO 26 1#
            # @DO 27 1#
            # @DO 28 1#
            # @DO 29 1#
            # @DO 30 1#
            # @DO 31 1#
            # @DO 32 1#
            # @DO 33 1#
            # 03.08.2020
            # 20.00
            w70 = ["@DO 17 1#", "@DO 18 1#", "@DO 23 1#", "@DO 24 1#", "@DO 25 1#", "@DO 26 1#", "@DO 27 1#", "@DO 28 1#", "@DO 29 1#", "@DO 30 1#", "@DO 31 1#", "@DO 32 1#", "@DO 33 1#"]
            # @DO 54 0#
            # @DO 55 0#
            # @DO 56 0#
            # @DO 57 0#
            #
            # 03.08.2020
            # 20.00
            w71 = ["@DO 54 0#", "@DO 55 0#", "@DO 56 0#", "@DO 57 0#", "@DO 58 1#", "@DO 59 1#", "@DO 60 1#", "@DO 61 1#"]
            Insert Into Array(inArray=w70, new=w71) -> w72
            call "CMD_Iteration.gvi"(VISA_IN=w48, ARRAY_IN=w72, ERROR_IN=w49) -> (VISA Answer=w51, ERROR_OUT=w50)
          }
          frame "Series 4" {
            # @DO 17 0#
            # @DO 18 1#
            # @DO 23 0#
            # @DO 24 1#
            # @DO 25 1#
            # @DO 26 0#
            # @DO 27 0#
            # @DO 28 0#
            # @DO 29 0#
            # @DO 30 0#
            # @DO 31 0#
            # @DO 32 0#
            # @DO 33 0#
            #
            # 03.08.2020
            # 20.02
            w73 = ["@DO 17 0#", "@DO 18 1#", "@DO 23 0#", "@DO 24 1#", "@DO 25 1#", "@DO 26 0#", "@DO 27 0#", "@DO 28 0#", "@DO 29 0#", "@DO 30 0#", "@DO 31 0#", "@DO 32 0#", "@DO 33 0#"]
            w74 = ["@DO 54 1#", "@DO 55 1#", "@DO 56 1#", "@DO 57 1#", "@DO 58 1#", "@DO 59 1#", "@DO 60 1#", "@DO 61 1#"]
            Insert Into Array(inArray=w73, new=w74) -> w75
            call "CMD_Iteration.gvi"(VISA_IN=w48, ARRAY_IN=w75, ERROR_IN=w49) -> (VISA Answer=w51, ERROR_OUT=w50)
          }
          frame "Series 4 Diode" {
            # @DO 17 0#
            # @DO 18 1#
            # @DO 23 0#
            # @DO 24 1#
            # @DO 25 1#
            # @DO 26 0#
            # @DO 27 0#
            # @DO 28 0#
            # @DO 29 0#
            # @DO 30 0#
            # @DO 31 0#
            # @DO 32 0#
            # @DO 33 0#
            #
            # 03.08.2020
            # 20.03
            w76 = ["@DO 17 0#", "@DO 18 1#", "@DO 23 0#", "@DO 24 1#", "@DO 25 1#", "@DO 26 0#", "@DO 27 0#", "@DO 28 0#", "@DO 29 0#", "@DO 30 0#", "@DO 31 0#", "@DO 32 0#", "@DO 33 0#"]
            # @DO 58 0#
            # @DO 59 0#
            # @DO 60 0#
            # @DO 61 0#
            #
            # 03.08.2020
            # 20.04
            w77 = ["@DO 54 1#", "@DO 55 1#", "@DO 56 1#", "@DO 57 1#", "@DO 58 0#", "@DO 59 0#", "@DO 60 0#", "@DO 61 0#"]
            Insert Into Array(inArray=w76, new=w77) -> w78
            call "CMD_Iteration.gvi"(VISA_IN=w48, ARRAY_IN=w78, ERROR_IN=w49) -> (VISA Answer=w51, ERROR_OUT=w50)
          }
          frame "Parallel Of Series" {
            # @DO 17 1#
            # @DO 18 1#
            # @DO 23 1#
            # @DO 24 1#
            # @DO 25 1#
            # @DO 26 1#
            # @DO 27 0#
            # @DO 28 1#
            # @DO 29 0#
            # @DO 30 0#
            # @DO 31 1#
            # @DO 32 0#
            # @DO 33 1#
            #
            # 03.08.2020
            # 20.05
            w79 = ["@DO 17 1#", "@DO 18 1#", "@DO 23 1#", "@DO 24 1#", "@DO 25 1#", "@DO 26 1#", "@DO 27 0#", "@DO 28 1#", "@DO 29 0#", "@DO 30 0#", "@DO 31 1#", "@DO 32 0#", "@DO 33 1#"]
            w80 = ["@DO 54 1#", "@DO 55 1#", "@DO 56 1#", "@DO 57 1#", "@DO 58 1#", "@DO 59 1#", "@DO 60 1#", "@DO 61 1#"]
            Insert Into Array(inArray=w79, new=w80) -> w81
            call "CMD_Iteration.gvi"(VISA_IN=w48, ARRAY_IN=w81, ERROR_IN=w49) -> (VISA Answer=w51, ERROR_OUT=w50)
          }
          frame "Parallel Of Series Diode" {
            # @DO 17 1#
            # @DO 18 1#
            # @DO 23 1#
            # @DO 24 1#
            # @DO 25 1#
            # @DO 26 1#
            # @DO 27 0#
            # @DO 28 1#
            # @DO 29 0#
            # @DO 30 0#
            # @DO 31 1#
            # @DO 32 0#
            # @DO 33 1#
            #
            # 03.08.2020
            # 20.06
            # @DO 58 0#
            # @DO 59 0#
            # @DO 60 0#
            # @DO 61 0#
            #
            # 03.08.2020
            # 20.097
            w82 = ["@DO 17 1#", "@DO 18 1#", "@DO 23 1#", "@DO 24 1#", "@DO 25 1#", "@DO 26 1#", "@DO 27 0#", "@DO 28 1#", "@DO 29 0#", "@DO 30 0#", "@DO 31 1#", "@DO 32 0#", "@DO 33 1#"]
            w83 = ["@DO 54 1#", "@DO 55 1#", "@DO 56 1#", "@DO 57 1#", "@DO 58 0#", "@DO 59 0#", "@DO 60 0#", "@DO 61 0#"]
            Insert Into Array(inArray=w82, new=w83) -> w84
            call "CMD_Iteration.gvi"(VISA_IN=w48, ARRAY_IN=w84, ERROR_IN=w49) -> (VISA Answer=w51, ERROR_OUT=w50)
          }
          frame "Series Of Parallel" {
            w85 = ["@DO 54 1#", "@DO 55 1#", "@DO 56 1#", "@DO 57 1#", "@DO 58 1#", "@DO 59 1#", "@DO 60 1#", "@DO 61 1#"]
            # @DO 17 1#
            # @DO 18 0#
            # @DO 23 0#
            # @DO 24 0#
            # @DO 25 0#
            # @DO 26 1#
            # @DO 27 1#
            # @DO 28 1#
            # @DO 29 1#
            # @DO 30 1#
            # @DO 31 1#
            # @DO 32 1#
            # @DO 33 1#
            #
            # 03.08.2020
            # 20.07
            w86 = ["@DO 17 1#", "@DO 18 0#", "@DO 23 0#", "@DO 24 0#", "@DO 25 0#", "@DO 26 1#", "@DO 27 1#", "@DO 28 1#", "@DO 29 1#", "@DO 30 1#", "@DO 31 1#", "@DO 32 1#", "@DO 33 1#"]
            Insert Into Array(inArray=w86, new=w85) -> w87
            call "CMD_Iteration.gvi"(VISA_IN=w48, ARRAY_IN=w87, ERROR_IN=w49) -> (VISA Answer=w51, ERROR_OUT=w50)
          }
          frame "Series Of Parallel Diode" {
            # @DO 17 1#
            # @DO 18 0#
            # @DO 23 0#
            # @DO 24 0#
            # @DO 25 0#
            # @DO 26 1#
            # @DO 27 1#
            # @DO 28 1#
            # @DO 29 1#
            # @DO 30 1#
            # @DO 31 1#
            # @DO 32 1#
            # @DO 33 1#
            #
            # 03.08.2020
            # 20.08
            w88 = ["@DO 17 1#", "@DO 18 0#", "@DO 23 0#", "@DO 24 0#", "@DO 25 0#", "@DO 26 1#", "@DO 27 1#", "@DO 28 1#", "@DO 29 1#", "@DO 30 1#", "@DO 31 1#", "@DO 32 1#", "@DO 33 1#"]
            # @DO 54 0#
            # @DO 55 0#
            # @DO 56 0#
            # @DO 57 0#
            #
            # 20.09
            # 03.08.2020
            w89 = ["@DO 54 0#", "@DO 55 0#", "@DO 56 0#", "@DO 57 0#", "@DO 58 1#", "@DO 59 1#", "@DO 60 1#", "@DO 61 1#"]
            Insert Into Array(inArray=w88, new=w89) -> w90
            call "CMD_Iteration.gvi"(VISA_IN=w48, ARRAY_IN=w90, ERROR_IN=w49) -> (VISA Answer=w51, ERROR_OUT=w50)
          }
        }
        call "PV_switch.gvi"(VISA_IN=w45, CTRL="Connect", ERROR_IN=w50) -> (ERROR_OUT=w18)
        $"VISA Answer" <- w51
        w19 = s2
        w20 = default
      }
      frame "Reset CVM" {
        Property Node(instance in=s3) -> ("VISA Resource"=w91, instance out=w21)
        # VOLTAGE RANGE
        # @DO 51 0#
        # @DO 52 0#
        # @DO 53 0#
        # CURRENT RANGE
        # @DO 50 1#
        call "CMD_Iteration.gvi"(VISA_IN=w91, ARRAY_IN=["@DO 51 1#", "@DO 52 1#", "@DO 53 1#"], ERROR_IN=w17) -> (VISA_OUT=w92, ERROR_OUT=w93)
        call "CMD_Iteration.gvi"(VISA_IN=w92, ARRAY_IN=["@DO 50 1#"], ERROR_IN=w93) -> (ERROR_OUT=w18)
        $"Voltage coeff" <- 1
        $"Current coeff" <- 1
        w19 = s2
        w20 = default
      }
      frame "VAC" {
        w94 = ["1", "2", "3", "10", "20", "40", "100", "200", "1000", "2000", "4000"]
        Array Size(array=w94) -> (size(s)=w95)
        Is Less Or Equal(x=$"VAC Load Counter", y=w95) -> w96
        Property Node(instance in=s3) -> ("VISA Resource"=w97, instance out=w21)
        Variant To Data(type=timestamp 1904-01-01T00:00:00Z, variant=w16) -> (data=w98)
        Get Current Time() -> (current time=w99)
        Timestamp Subtract(x=w99, y=w98) -> w100
        Is Greater Or Equal(x=w100, y=1) -> w101
        Logical And(w101, w96) -> w102
        case (w102) {
          frame False, Default {
            w103 = w17
            w104 = w98
            w105 = $"VAC Load Counter"
          }
          frame True {
            Get Current Time() -> (current time=w104)
            # Disconnect ALL load
            Array Index(array=w94) -> (out0[$"VAC Load Counter"]=w106)
            w107 = ["@DO 42 1#", "@DO 34 0#", "@DO 35 0#", "@DO 36 0#", "@DO 37 0#", "@DO 38 0#", "@DO 39 0#", "@DO 40 0#", "@DO 41 0#", "@DO 43 0#", "@DO 44 0#", "@DO 45 0#", "@DO 46 0#", "@DO 47 0#", "@DO 48 0#", "@DO 49 0#"]
            call "CMD_Iteration.gvi"(VISA_IN=w97, ARRAY_IN=w107, ERROR_IN=w17) -> (ERROR_OUT=w108)
            s4 = w106  # shift register
            while {
              Match Pattern(regular expression=",", string=s4) -> (after substring=w109, before substring=w110)
              case (w110) {
                frame "1", Default {
                  call "Read_Write_VISA.gvi"(VISA_IN=w97, CMD="@DO 43 1#", ERROR_IN=w108) -> (ERROR_OUT=w111)
                }
                frame "2" {
                  call "Read_Write_VISA.gvi"(VISA_IN=w97, CMD="@DO 44 1#", ERROR_IN=w108) -> (ERROR_OUT=w111)
                }
                frame "3" {
                  call "Read_Write_VISA.gvi"(VISA_IN=w97, CMD="@DO 45 1#", ERROR_IN=w108) -> (ERROR_OUT=w111)
                }
                frame "5" {
                  call "Read_Write_VISA.gvi"(VISA_IN=w97, CMD="@DO 46 1#", ERROR_IN=w108) -> (ERROR_OUT=w111)
                }
                frame "10" {
                  call "Read_Write_VISA.gvi"(VISA_IN=w97, CMD="@DO 47 1#", ERROR_IN=w108) -> (ERROR_OUT=w111)
                }
                frame "20" {
                  call "Read_Write_VISA.gvi"(VISA_IN=w97, CMD="@DO 48 1#", ERROR_IN=w108) -> (ERROR_OUT=w111)
                }
                frame "40" {
                  call "Read_Write_VISA.gvi"(VISA_IN=w97, CMD="@DO 49 1#", ERROR_IN=w108) -> (ERROR_OUT=w111)
                }
                frame "50" {
                  call "Read_Write_VISA.gvi"(VISA_IN=w97, CMD="@DO 34 1#", ERROR_IN=w108) -> (ERROR_OUT=w111)
                }
                frame "100" {
                  call "Read_Write_VISA.gvi"(VISA_IN=w97, CMD="@DO 35 1#", ERROR_IN=w108) -> (ERROR_OUT=w111)
                }
                frame "200" {
                  call "Read_Write_VISA.gvi"(VISA_IN=w97, CMD="@DO 36 1#", ERROR_IN=w108) -> (ERROR_OUT=w111)
                }
                frame "400" {
                  call "Read_Write_VISA.gvi"(VISA_IN=w97, CMD="@DO 37 1#", ERROR_IN=w108) -> (ERROR_OUT=w111)
                }
                frame "500" {
                  call "Read_Write_VISA.gvi"(VISA_IN=w97, CMD="@DO 38 1#", ERROR_IN=w108) -> (ERROR_OUT=w111)
                }
                frame "1000" {
                  call "Read_Write_VISA.gvi"(VISA_IN=w97, CMD="@DO 39 1#", ERROR_IN=w108) -> (ERROR_OUT=w111)
                }
                frame "2000" {
                  call "Read_Write_VISA.gvi"(VISA_IN=w97, CMD="@DO 40 1#", ERROR_IN=w108) -> (ERROR_OUT=w111)
                }
                frame "4000" {
                  call "Read_Write_VISA.gvi"(VISA_IN=w97, CMD="@DO 41 1#", ERROR_IN=w108) -> (ERROR_OUT=w111)
                }
                frame "0" {
                  # Для измерения тока К.З.
                  # Схема сопротивления
                  # 1 Ом + 1 Ом токовый резистор
                  w111 = w108
                }
              }
              Is Empty String Or Path(string/path=w109) -> w112
              next s4 = w109
              stop if w112
            }
            call "Read_Write_VISA.gvi"(VISA_IN=w97, CMD="@DO 42 0#", ERROR_IN=w111) -> (ERROR_OUT=w103)
            Increment(x=$"VAC Load Counter") -> w105
          }
        }
        call "Enqueue Message (Single).gvi"(message queue in=w14, message="Watchdog", error in=w103) -> (error out=w113)
        case (w96) {
          frame False, Default {
            w18 = w113
          }
          frame True {
            call "Enqueue Message (Single).gvi"(message queue in=w14, message="VAC", message data=w104, error in=w113) -> (error out=w18)
          }
        }
        $"VAC Load Counter" <- w105
        w19 = s2
        w20 = default
      }
      frame "Prepare CVM" {
        Property Node(instance in=s3) -> ("VISA Resource"=w114, "Physical Channel"=w115, instance out=w21)
        call "DAQmx Read (Analog 2D DBL NChan NSamp).gvi"(task in=w115, error in=w17, number of samples per channel=1) -> (error out=w116, data=w117)
        Array Index(array=w117) -> (out0[2, 0]=w118)
        Multiply(w118, 4) -> w119
        C Code Node("x"=w119) -> ("y"=w120, Error Out=w121)
        ~~~
        if(x>-1 && x<=1)
          y = 0;
        if(x>1 && x<=10)
          y = 1;
        if(x>10 && x<=20)
          y = 2;
        if(x>20 && x<=30)
          y = 3;
        ~~~
        $"Voltage Range" <- w120
        # Voltage Range
        case (w120) {
          frame 0, Default {
            call "CMD_Iteration.gvi"(VISA_IN=w114, ARRAY_IN=["@DO 51 1#", "@DO 52 1#", "@DO 53 0#"], ERROR_IN=w121) -> (VISA Answer=w124, ERROR_OUT=w122)
            w123 = 0.1
          }
          frame 1 {
            call "CMD_Iteration.gvi"(VISA_IN=w114, ARRAY_IN=["@DO 51 1#", "@DO 52 1#", "@DO 53 1#"], ERROR_IN=w121) -> (VISA Answer=w124, ERROR_OUT=w122)
            w123 = 1
          }
          frame 2 {
            call "CMD_Iteration.gvi"(VISA_IN=w114, ARRAY_IN=["@DO 51 1#", "@DO 52 0#", "@DO 53 1#"], ERROR_IN=w121) -> (VISA Answer=w124, ERROR_OUT=w122)
            w123 = 0.5
          }
          frame 3 {
            # Div x0.25 works with 2 relay
            call "CMD_Iteration.gvi"(VISA_IN=w114, ARRAY_IN=["@DO 51 0#\n"], ERROR_IN=w121) -> (VISA Answer=w124, ERROR_OUT=w122)
            w123 = 0.25
          }
        }
        $"Voltage coeff" <- w123
        $"VISA Answer_2" <- w124
        Array Index(array=w117) -> (out0[3, 0]=w125)
        # Tip For Local Wiring Solution
        # Relay 1(50) 	DO 1- REP A x1
        # 		DO 0- AMP A x10
        #
        # Relay 2(51) 	DO 1-REP V x1
        # 		DO 0-DIV V x0.25
        # Relay 3(52) 	DO 1-REP V x1
        # 		DO 0-DIV V x0.5
        # Relay 4(53) 	DO 1-REP V x1
        # 		DO 0-AMP V x10
        C Code Node("x"=w125) -> ("y"=w126)
        ~~~
        if(x>-1 && x<=0.6)
          y = 0;
        if(x>0.6 && x<=6)
          y = 1;
        ~~~
        # Current Range
        case (w126) {
          frame 0, Default {
            call "CMD_Iteration.gvi"(VISA_IN=w114, ARRAY_IN=["@DO 50 0#"]) -> (ERROR_OUT=w127)
            w128 = 0.1
          }
          frame 1 {
            call "CMD_Iteration.gvi"(VISA_IN=w114, ARRAY_IN=["@DO 50 1#"]) -> (ERROR_OUT=w127)
            w128 = 1
          }
        }
        $"Current coeff" <- w128
        Merge Errors(w122, w127, w116) -> (error out=w18)
        w19 = s2
        w20 = default
      }
      frame "Fans Control" {
        Property Node(instance in=s3) -> ("VISA Resource"=w129, instance out=w21)
        Variant To Data(error in (no error)=w17, type=string "", variant=w16) -> (data=w130, error out=w131)
        case (w130) {
          frame "Turn All Off", Default {
            w132 = ["@DO 7 1#", "@DO 8 1#"]
          }
          frame "Turn All On" {
            w132 = ["@DO 7 0#", "@DO 8 0#"]
          }
          frame "Turn 1,2 On" {
            w132 = ["@DO 7 1#", "@DO 8 0#", ""]
          }
          frame "Turn 3,4 On" {
            w132 = ["@DO 8 1#", "@DO 7 0#"]
          }
        }
        call "CMD_Iteration.gvi"(VISA_IN=w129, ARRAY_IN=w132, ERROR_IN=w131) -> (ERROR_OUT=w18)
        w19 = s2
        w20 = default
      }
      frame "Optic Filter Config" {
        Property Node(instance in=s3) -> ("VISA Resource"=w133, instance out=w21)
        Variant To Data(error in (no error)=w17, type=string "", variant=w16) -> (data=w134, error out=w135)
        case (w134) {
          frame "None", Default {
            w136 = ["@SERV 3 90#", "@SERV 4 0#"]
          }
          frame "Filter 1" {
            w136 = ["@SERV 3 90#", "@SERV 4 0#", "@SERV 3 0#"]
          }
          frame "Filter 2" {
            w136 = ["@SERV 3 90#", "@SERV 4 0#", "@SERV 4 90#"]
          }
        }
        call "CMD_Iteration.gvi"(VISA_IN=w133, ARRAY_IN=w136, ERROR_IN=w135) -> (ERROR_OUT=w18)
        w19 = s2
        w20 = default
      }
      frame "Set PV Angle" {
        Property Node(instance in=s3) -> ("VISA Resource"=w137, instance out=w21)
        Variant To Data(error in (no error)=w17, type=u32 0, variant=w16) -> (data=w138, error out=w139)
        # Set angle limits for PV panels
        In Range And Coerce(lower limit=0, upper limit=180, x=w138) -> (coerced(x)=w140)
        Number To Decimal String(number=w140) -> (decimal integer string=w141)
        Concatenate Strings("@SERV 13 ", w141, " #") -> w142
        call "Read_Write_VISA.gvi"(VISA_IN=w137, CMD=w142, ERROR_IN=w139) -> (ERROR_OUT=w18)
        w19 = s2
        w20 = default
      }
      frame "Brightness Config" {
        Property Node(instance in=s3) -> ("VISA Resource"=w143, instance out=w21)
        Variant To Data(error in (no error)=w17, type=u32 0, variant=w16) -> (data=w144, error out=w145)
        # Set brightness limits
        In Range And Coerce(lower limit=0, upper limit=100, x=w144) -> (coerced(x)=w146)
        Number To Decimal String(number=w146) -> (decimal integer string=w147)
        Concatenate Strings("@DIM 6 ", w147, " #") -> w148
        call "Read_Write_VISA.gvi"(VISA_IN=w143, CMD=w148, ERROR_IN=w145) -> (ERROR_OUT=w18)
        w19 = s2
        w20 = default
      }
      frame "IR Thermometer" {
        Property Node(instance in=s3) -> ("VISA Resource"=w149, instance out=w21)
        Variant To Data(error in (no error)=w17, type=string "", variant=w16) -> (data=w150, error out=w151)
        case (w150) {
          frame "None", Default {
            w152 = "@SERV 5 0#"
          }
          frame "Panel 1" {
            w152 = "@SERV 5 50#"
          }
          frame "Panel 2" {
            w152 = "@SERV 5 90#"
          }
          frame "Panel 3" {
            w152 = "@SERV 5 120#"
          }
          frame "Panel 4" {
            w152 = "@SERV 5 150#"
          }
        }
        call "Read_Write_VISA.gvi"(VISA_IN=w149, CMD=w152, ERROR_IN=w151) -> (ERROR_OUT=w18)
        w19 = s2
        w20 = default
      }
      frame "Set Resistance" {
        Property Node(instance in=s3) -> ("VISA Resource"=w153, instance out=w21)
        Variant To Data(error in (no error)=w17, type=string "", variant=w16) -> (data=w154, error out=w155)
        # Disconnect ALL load
        w156 = ["@DO 42 1#", "@DO 34 0#", "@DO 35 0#", "@DO 36 0#", "@DO 37 0#", "@DO 38 0#", "@DO 39 0#", "@DO 40 0#", "@DO 41 0#", "@DO 43 0#", "@DO 44 0#", "@DO 45 0#", "@DO 46 0#", "@DO 47 0#", "@DO 48 0#", "@DO 49 0#"]
        call "CMD_Iteration.gvi"(VISA_IN=w153, ARRAY_IN=w156, ERROR_IN=w155) -> (VISA_OUT=w157, ERROR_OUT=w158)
        s5 = w154  # shift register
        while {
          Match Pattern(regular expression=",", string=s5) -> (after substring=w159, before substring=w160)
          case (w160) {
            frame "1", Default {
              call "Read_Write_VISA.gvi"(VISA_IN=w157, CMD="@DO 43 1#", ERROR_IN=w158) -> (ERROR_OUT=w161)
            }
            frame "2" {
              call "Read_Write_VISA.gvi"(VISA_IN=w157, CMD="@DO 44 1#", ERROR_IN=w158) -> (ERROR_OUT=w161)
            }
            frame "3" {
              call "Read_Write_VISA.gvi"(VISA_IN=w157, CMD="@DO 45 1#", ERROR_IN=w158) -> (ERROR_OUT=w161)
            }
            frame "5" {
              call "Read_Write_VISA.gvi"(VISA_IN=w157, CMD="@DO 46 1#", ERROR_IN=w158) -> (ERROR_OUT=w161)
            }
            frame "10" {
              call "Read_Write_VISA.gvi"(VISA_IN=w157, CMD="@DO 47 1#", ERROR_IN=w158) -> (ERROR_OUT=w161)
            }
            frame "20" {
              call "Read_Write_VISA.gvi"(VISA_IN=w157, CMD="@DO 48 1#", ERROR_IN=w158) -> (ERROR_OUT=w161)
            }
            frame "40" {
              call "Read_Write_VISA.gvi"(VISA_IN=w157, CMD="@DO 49 1#", ERROR_IN=w158) -> (ERROR_OUT=w161)
            }
            frame "50" {
              call "Read_Write_VISA.gvi"(VISA_IN=w157, CMD="@DO 34 1#", ERROR_IN=w158) -> (ERROR_OUT=w161)
            }
            frame "100" {
              call "Read_Write_VISA.gvi"(VISA_IN=w157, CMD="@DO 35 1#", ERROR_IN=w158) -> (ERROR_OUT=w161)
            }
            frame "200" {
              call "Read_Write_VISA.gvi"(VISA_IN=w157, CMD="@DO 36 1#", ERROR_IN=w158) -> (ERROR_OUT=w161)
            }
            frame "400" {
              call "Read_Write_VISA.gvi"(VISA_IN=w157, CMD="@DO 37 1#", ERROR_IN=w158) -> (ERROR_OUT=w161)
            }
            frame "500" {
              call "Read_Write_VISA.gvi"(VISA_IN=w157, CMD="@DO 38 1#", ERROR_IN=w158) -> (ERROR_OUT=w161)
            }
            frame "1000" {
              call "Read_Write_VISA.gvi"(VISA_IN=w157, CMD="@DO 39 1#", ERROR_IN=w158) -> (ERROR_OUT=w161)
            }
            frame "2000" {
              call "Read_Write_VISA.gvi"(VISA_IN=w157, CMD="@DO 40 1#", ERROR_IN=w158) -> (ERROR_OUT=w161)
            }
            frame "4000" {
              call "Read_Write_VISA.gvi"(VISA_IN=w157, CMD="@DO 41 1#", ERROR_IN=w158) -> (ERROR_OUT=w161)
            }
            frame "0" {
              # Для измерения тока К.З.
              # Схема сопротивления
              # 1 Ом + 1 Ом токовый резистор
              w161 = w158
            }
          }
          Is Empty String Or Path(string/path=w159) -> w162
          next s5 = w159
          stop if w162
        }
        # Connect Load
        call "Read_Write_VISA.gvi"(VISA_IN=w153, CMD="@DO 42 0#", ERROR_IN=w161) -> (ERROR_OUT=w18)
        w19 = s2
        w20 = default
      }
      frame "Reset Resistance" {
        Property Node(instance in=s3) -> ("VISA Resource"=w163, instance out=w21)
        # Размыкаются всё реле, сопротивление- бесконечность
        w164 = ["@DO 42 1#", "@DO 34 1#", "@DO 35 1#", "@DO 36 1#", "@DO 37 1#", "@DO 38 1#", "@DO 39 1#", "@DO 40 1#", "@DO 41 1#", "@DO 43 1#", "@DO 44 1#", "@DO 45 1#", "@DO 46 1#", "@DO 47 1#", "@DO 48 1#", "@DO 49 1#"]
        # Сопротивление в начальное положение
        call "CMD_Iteration.gvi"(VISA_IN=w163, ARRAY_IN=w164, ERROR_IN=w17) -> (ERROR_OUT=w18)
        w19 = s2
        w20 = default
      }
      frame "Watchdog" {
        Property Node(instance in=s3) -> ("Physical Channel"=w165, "VISA Resource"=w166, instance out=w21)
        call "DAQmx Read (Analog 2D DBL NChan NSamp).gvi"(task in=w165, number of samples per channel=1) -> (data=w167)
        Array Index(array=w167) -> (out0[1, 0]=w168)
        Multiply(w168, 4) -> w169
        Multiply(w169, $"Voltage coeff") -> w170
        Feedback Node(input=w171) -> w172
        Build Array(w172, w170) -> w171
        $Graph <- w171
        $V_real <- w170
        Array Index(array=w167) -> (out0[0, 0]=w173)
        Divide(x=w173, y=0.07) -> w174
        Multiply(w174, $"Current coeff") -> w175
        $Current_real <- w175
        call "Read_Write_VISA.gvi"(VISA_IN=w166, CMD="@LUX 10 1#", ERROR_IN=w17) -> (OUTPUT=w176, TAG=w177, ERROR_OUT=w178)
        $LUX_2 <- w177
        call "Read_Write_VISA.gvi"(VISA_IN=w176, CMD="@TEMP 12 0#", ERROR_IN=w178) -> (TAG=w179, ERROR_OUT=w180)
        $TEMP_2 <- w179
        call "DAQmx Read (Analog 1D Wfm NChan NSamp).gvi"(task in=w165, error in=w180, number of samples per channel=1) -> (error out=w181, data=w182)
        $Chart <- w182
        Feedback Node(input=w183) -> w184
        Build Array(w184, w175) -> w183
        $Graph_2 <- w183
        call "Enqueue Message (Single).gvi"(message queue in=w14, message="Wait For Event", error in=w181) -> (error out=w18)
        w19 = s2
        w20 = default
      }
      frame "Error" {
        Variant To Data(error in (no error)=w17, type=no error, variant=w16) -> (data=w185, error out=w18)
        # #CodeRecommended - If you ever change the name of this "Error" message, you'll need to update the name in the Check Loop Error.vi as well.
        call "Display Error.gvi"(error in=w185)
        w19 = s2
        w20 = default
        w21 = s3
      }
      frame "Exit" {
        Generate User Event(event data=TRUE, user event=w3) -> (error out=w186)
        Release Queue(error in=w17, queue=w14) -> (error out=w187)
        Property Node(instance in=s3) -> ("VISA Resource"=w188, "Physical Channel"=w189, "tag"=w190, "configuration"=w191)
        call "Close Configuration.gvi"(configuration=w191) -> (error out=w192)
        call "Close Tag (Single).gvi"(tag=w190, error in=w192) -> (error out=w193)
        call "DAQmx Stop Task.gvi"(task in=w189, error in=w193) -> (error out=w194)
        call "Close (Instr).gvi"(session in=w188, error in=w194) -> (error out=w195)
        Merge Errors(w195, w186, w187) -> (error out=w18)
        w19 = s2
        w20 = TRUE
        w21 = default
      }
      frame Default {
        w196 = "The invalid message string \"%s\" was received in the Message Handling Loop."
        Format Into String(formatString=w196, w15) -> w197
        call "Build Error Cluster.gvi"(code=1, description=w197) -> (error out=w18)
        w19 = s2
        w20 = default
        w21 = s3
      }
    }
    call "Error Handler - Message Handling Loop.gvi"(message queue in=w14, error in=w18) -> (dup error in=w198)
    $Output <- w18
    next s2 = w19
    next s3 = w21
    stop if w20
  }
  disable {
    frame Enabled { }
    frame Disabled {
      call "Initialize.gvi"(device name="cam0") -> (session out=w199, error out=w200)
      call "Configure Grab.gvi"(session in=w199, error in=w200) -> (session out=w201, error out=w202)
      call "Create Image.gvi"(image name="image_1") -> (new image=w203)
      while {
        call "Grab.gvi"(session in=w201, error in=w202, image in=w203) -> (session out=w204, error out=w205, image out=w206)
        $Image <- w206
        stop if $Stop
      }
      call "Close.gvi"(session=w204, error in=w205)
    }
  }
